# Grasshopper definition 3D_SuspensionBridge.gh (Grasshopper 1.0.7)
# plug-ins: CEM_Deviation, CEM_Trail, CEM_Extract_Structure, CEM_Bound_Deviation, CEM_Bound_Trail, CEM_Bound_Origin_Node, CEM_Target, CEM_Material_Properties, CEM_Constraint_Plane, CEM_Extract_Topology, CEM_Build_Topology, CEM_Support, CEM_Load, CEM_Origin_Node, CEM_Optimization_Setup, CEM_Calculate_Structure, VGS1.00beta

# ---- group: CEM Topology
trailedge = Curve(flatten([<curve referenced from the Rhino model> x2]))
trailedge_2 = Curve(flatten([<curve referenced from the Rhino model> x22]))
trailedge_3 = Curve(flatten([<curve referenced from the Rhino model> x2]))
trailedge_4 = Curve(flatten([<curve referenced from the Rhino model> x22]))
pointload = Point(flatten([<point referenced from the Rhino model> x22]))
deviationedge = Curve(flatten([<curve referenced from the Rhino model> x22]))
deviationedge_2 = Curve(flatten(<curve referenced from the Rhino model>))
deviationedge_3 = Curve(flatten(<curve referenced from the Rhino model>))
support = Point()
deviationedge_4 = Curve(flatten([<curve referenced from the Rhino model> x2]))
cem_deviation = CEM_Deviation(DeviationEdge=deviationedge, DeviationMagn=Slider(0.5, range=-20..10))
cem_deviation_2 = CEM_Deviation(DeviationEdge=deviationedge_2, DeviationMagn=Slider(-20, range=-20..10))
cem_deviation_3 = CEM_Deviation(DeviationEdge=deviationedge_3, DeviationMagn=Slider(10, range=-20..10))
cem_deviation_4 = CEM_Deviation(DeviationEdge=deviationedge_4, DeviationMagn=Slider(-17.2, range=-20..10))
cem_load = CEM_Load(
    PointLoad=pointload,
    LoadMagnX=Slider(0, range=-10..10),
    LoadMagnY=Slider(0, range=-10..10),
    LoadMagnZ=Slider(-0.5, range=-10..10))
cem_trail = CEM_Trail(TrailEdge=trailedge, TrailLen=Slider(0, range=-10..10))
cem_trail_2 = CEM_Trail(TrailEdge=trailedge_2, TrailLen=Slider(-3, range=-10..10))
cem_trail_3 = CEM_Trail(TrailEdge=trailedge_3, TrailLen=Slider(20, range=-10..20))
cem_trail_4 = CEM_Trail(TrailEdge=trailedge_4, TrailLen=Slider(3, range=-10..10))
cem_support = CEM_Support(Support=support)
cem_build_topology = CEM_Build_Topology(
    T=[cem_trail_4, cem_trail_2, cem_trail, cem_trail_3],
    L=cem_load,
    D=[cem_deviation, cem_deviation_2, cem_deviation_3, cem_deviation_4],
    S=cem_support)
panel = Panel(cem_build_topology)
cem_extract_topology = CEM_Extract_Topology(TP=cem_build_topology)  # -> Nodes, NodesID, Edges, EdgesID, ConstraintPlane, ConstraintPlaneID, OriginNode, OriginNodeID

# ---- group: CEM Form-Finding
boundoriginnodeid = Panel("""1
3
6
9""")
targetnode = Panel("""15
13
12
14""")
originnodes = Point([<point referenced from the Rhino model> x6])
series = Series(Start=0, Step=1, Count=11)
series_2 = Series(Start=12, Step=1, Count=16)
self_weight = BooleanToggle(False)
list = ValueList({"LD_AUGLAG", "LD_LBFGS", "LD_SLSQP", "LD_TNEWTON", "LN_BOBYQA", "LN_COBYLA", "LN_SBPLX", "GD_MLSL", "GN_MLSL", "GN_ISRES"}, selected="LD_LBFGS")
specific_weight_kn_m3 = Slider(73.5, range=5..500)
yieldstress_kn_m2 = Slider(500000, range=50..1000000)
targetnodes = Point([<point referenced from the Rhino model> x4])
targetnodeid = Integer(targetnode)
targetvector = Vector()
targetvectorid = Integer()
targetvectorcoeffmag = Slider(0, range=0..10000)
targetvectorcoeffdir = Slider(0, range=0..10000)
boundscoefficientoriginnodex = Slider(0.2, range=0..1000)
boundtrailid = Integer(series)
bounddevid = Integer(series_2)
boundoriginnodeid_2 = Integer(boundoriginnodeid)
cem_bound_origin_node = CEM_Bound_Origin_Node(
    BoundOriginNodeID=boundoriginnodeid_2,
    BoundUpOriginNodeX=boundscoefficientoriginnodex,
    BoundLowOriginNodeX=boundscoefficientoriginnodex,
    BoundUpOriginNodeY=boundscoefficientoriginnodex,
    BoundLowOriginNodeY=boundscoefficientoriginnodex)
cem_target = CEM_Target(
    TargetNode=targetnodes,
    TargetNodeID=targetnodeid,
    TargetNodeCoeff=Slider(1, range=0..10000),
    TargetVector=targetvector,
    TargetVectorID=targetvectorid,
    TargetVectorCoeffMag=targetvectorcoeffmag,
    MarshallingSignalParameter=targetvectorcoeffdir)
cem_origin_node = CEM_Origin_Node(OriginNode=originnodes, OriginNodeID=cem_extract_topology.OriginNodeID)
cem_constraint_plane = CEM_Constraint_Plane(ConstraintPlaneID=cem_extract_topology.ConstraintPlaneID)
cem_bound_trail = CEM_Bound_Trail(BoundTrailID=boundtrailid, BoundUpTrail=Slider(10, range=0..5000), BoundLowTrail=Slider(10, range=0..5000))
cem_bound_deviation = CEM_Bound_Deviation(BoundDevID=bounddevid, BoundUpDev=Slider(20, range=0..5000), BoundLowDev=Slider(20, range=0..5000))
cem_material_properties = CEM_Material_Properties(SelfWeight=self_weight, YieldStress=yieldstress_kn_m2, SpecWeight=specific_weight_kn_m3)
cem_optimization_setup = CEM_Optimization_Setup(
    TO=cem_target,
    BO=cem_bound_origin_node,
    BT=cem_bound_trail,
    BD=cem_bound_deviation,
    GradientDelta=Slider(0.0001, range=0.0001..1),
    RelativeTolerance=Slider(1e-06, range=1e-06..1),
    MaxIterations=Slider(20, range=1..1000),
    OptimAlgorithm=list)
cem_calculate_structure = CEM_Calculate_Structure(TP=cem_build_topology, CPL=cem_constraint_plane, N=cem_origin_node, SW=cem_material_properties, O=cem_optimization_setup)

# ---- group: CEM Extract Model
cem_extract_structure = CEM_Extract_Structure(M=cem_calculate_structure)  # -> Nodes, NodesID, Trails, TrailsID, TrailsCol, TrailsMag, Deviations, DeviationsID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
preview = CustomPreview(
    Geometry=[cem_extract_structure.Trails, cem_extract_structure.ExternalForces, cem_extract_structure.Deviations],
    Material=[cem_extract_structure.TrailsCol, cem_extract_structure.ExternalForcesCol, cem_extract_structure.DeviationsCol])
tag = TextTag3D(
    Location=cem_extract_structure.Nodes,
    Text=cem_extract_structure.NodesID,
    Size=0.25,
    Colour=RGB(0, 0, 0),
    Justification=7)

# ----
internal_forces = _1InternalForcesVGS(Ln=cem_extract_structure.Deviations, Mag=cem_extract_structure.DeviationsMag)
external_forces = _2ExternalForcesVGS(ForceLn=cem_extract_structure.ExternalForces)
internal_forces_2 = _1InternalForcesVGS(Ln=cem_extract_structure.Trails, Mag=cem_extract_structure.TrailsMag)
assemble_form_diagram = _3AssembleFormDiagramVGS(IntForce=[internal_forces_2, internal_forces], ExtForce=external_forces)

visualize_diagrams = _1VisualizeDiagramsVGS(
    FF=assemble_form_diagram,
    ThickLn=0.1,
    ThickLnVar=1,
    SizeTxt=0.3,
    NodeID=2147483647,
    display_Edge_line=True,
    display_Edge_text=True,
    display_Load_line=True,
    display_Load_text=True,
    display_Node_circle=True,
    display_Node_text=True,
    display_React_line=True,
    display_React_text=True,
    display_Result_line=True,
    display_Result_text=True)
generate_force_diagram = _4GenerateForceDiagramVGS(F=assemble_form_diagram, GlobEq=True, Reset=Button(), FormFinding=False)
pt = Point(<point referenced from the Rhino model>)
locate_diagram = _2LocateDiagramVGS(FF=generate_force_diagram, LocPt=pt)
visualize_diagrams_2 = _1VisualizeDiagramsVGS(
    FF=locate_diagram,
    ThickLn=0.1,
    ThickLnVar=1,
    SizeTxt=0.3,
    NodeID=2147483647,
    display_Edge_line=True,
    display_Edge_text=True,
    display_Load_line=True,
    display_Load_text=True,
    display_Node_circle=True,
    display_Node_text=True,
    display_React_line=True,
    display_React_text=True,
    display_Result_line=True,
    display_Result_text=True)
